# Grasshopper definition BlendSrf_RC.ghx (Grasshopper 1.0.7)

# Case 2
number_slider = Slider(88, range=1..359)
# Case 1
panel = Panel("20,0,0")
srf = Surface(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)
X = UnitX(Factor=1)
rad = Radians(Degrees=number_slider)
line = LineSDL(Start=panel, Direction=X, Length="50")
xz = XZPlane(Origin=Point(0, 0, 0))  # disabled
Z = UnitZ(Factor="50")
extr = Extrude(Base=line, Direction=Z)
mirror = Mirror(Geometry=srf, Plane=xz)  # -> Geometry, Transform; disabled
rotate = Rotate(Geometry=extr, Angle=rad, Plane=PlaneXY(0, 0, 0))  # -> Geometry, Transform
flip = Flip(Surface=mirror.Geometry)  # -> Surface, Result; disabled
rotate_2 = Rotate(Geometry=srf, Angle=rad, Plane=PlaneXY(0, 0, 0))  # -> Geometry, Transform

# ---- group: 1A
srf_2 = Surface(extr)

# ---- group: 1B
srf_3 = Surface(rotate.Geometry)

# ---- group: 2A
srf_4 = Surface(srf)

# ---- group: 2B
srf_5 = Surface(rotate_2.Geometry)

# ---- group: A
srf_6 = Surface(srf_4)

# ---- group: B
srf_7 = Surface(srf_5)

# ----
debrep = DeconstructBrep(Brep=srf_6)  # -> Faces, Edges, Vertices
debrep_2 = DeconstructBrep(Brep=srf_7)  # -> Faces, Edges, Vertices

# ---- group: Edges
crv = Curve(debrep.Edges)

crv_2 = Curve(debrep_2.Edges)

# ----
midpt = CurveMiddle(Curve=crv)
dist = Distance(PointA="0,0,0", PointB=midpt)
sort = SortList(Keys=dist, ValuesA=crv)  # -> Keys, ValuesA
item = ListItem(List=sort.ValuesA, Index=0, Wrap=True)

midpt_2 = CurveMiddle(Curve=crv_2)
dist_2 = Distance(PointA="0,0,0", PointB=midpt_2)
sort_2 = SortList(Keys=dist_2, ValuesA=crv_2)  # -> Keys, ValuesA
item_2 = ListItem(List=sort_2.ValuesA, Index=0, Wrap=True)

# ---- group: Edge
crv_3 = Curve(item)

crv_4 = Curve(item_2)

# ----
midpt_3 = CurveMiddle(Curve=crv_3)
midpt_4 = CurveMiddle(Curve=crv_4)
crv_cp = CurveClosestPoint(Point=simplify(midpt_3), Curve=simplify(debrep.Edges))  # -> Point, Parameter, Distance
crv_cp_2 = CurveClosestPoint(Point=simplify(midpt_4), Curve=simplify(debrep_2.Edges))  # -> Point, Parameter, Distance
Z_2 = UnitZ(Factor=1)
panel_2 = Panel("""min_edge = min(EDGE)
#print(mi)

idx = EDGE.index(min_edge)

EDGE_IDX = idx""")
line_2 = LineSDL(Start="0,0,0", Direction=Z_2, Length="100")

# ---- group: Get Edge-Index
python = GhPythonScript(Code=panel_2, EDGE=crv_cp.Distance)  # -> Out, EDGE_IDX

python_2 = GhPythonScript(Code=panel_2, EDGE=crv_cp_2.Distance)  # -> Out, EDGE_IDX

# ----
flip_2 = FlipCurve(Curve=crv_3, Guide=line_2)  # -> Curve, Flag
flip_3 = FlipCurve(Curve=crv_4, Guide=line_2)  # -> Curve, Flag
srf_8 = Surface(srf_6)
srf_9 = Surface(srf_7)
panel_3 = Panel(python.EDGE_IDX)
panel_4 = Panel(python_2.EDGE_IDX)

# ---- group: BlendType
# https://developer.rhino3d.com/api/rhinocommon/rhino.geometry.blendcontinuity
list = ValueList({"Position", "Tangency", "Curvature"}, selected="Curvature")

# ----
python_3 = GhPythonScript(
    TYPE=list,
    s0=graft(srf_8),
    s1=graft(srf_9),
    e0=python.EDGE_IDX,
    e1=python_2.EDGE_IDX,
    d0=crv_3,
    d1=crv_4,
    f0=flip_2.Flag,
    f1=flip_3.Flag)  # -> out, s0_out, s1_out, result_srf; inputs s0: Brep, s1: Brep, e0: Int32, e1: Int32, d0: Curve, d1: Curve, f1: Boolean
# ---------- python_3: Python ----------
msg = "BlendSrf"
ghenv.Component.Message = msg

import Rhino.Geometry as rg

if TYPE == "Position":
    type_ = rg.BlendContinuity.Position
elif TYPE == "Tangency":
    type_ = rg.BlendContinuity.Tangency
elif TYPE == "Curvature":
    type_ = rg.BlendContinuity.Curvature
    

#print(s0.Faces[0])

result_srf = rg.Brep.CreateBlendSurface(s0.Faces[0], s0.Edges[e0], d0.Domain, f0, type_, s1.Faces[0], s1.Edges[e1], d1.Domain, f1, type_)

s0_out = s0
s1_out = s1
# ---------- end python_3 ----------
merge = Merge(Data1=python_3.s0_out, Data2=python_3.s1_out)  # -> flatten(Result)
srf_10 = Surface(python_3.result_srf)
merge_2 = Merge(Data1=merge, Data2=srf_10)  # -> flatten(Result)

# ---- group: RESULT
join = BrepJoin(Breps=merge_2)  # -> Breps, Closed
