# Grasshopper definition ExtendSrf_RC.ghx (Grasshopper 1.0.7)

cir = Circle(Plane=PlaneXY(0, 0, 0), Radius="100")
rectangle = Rectangle(Plane=PlaneXY(0, 0, 0), XSize="100", YSize="100", Radius=0)  # -> Rectangle, Length
boundary = BoundarySurfaces(Edges=cir)
boundary_2 = BoundarySurfaces(Edges=rectangle.Rectangle)
untrim = Untrim(Surface=boundary)

# ---- group: Test_1
srf = Surface(boundary_2)

# ---- group: Test_2
srf_2 = Surface(untrim)

# ----
number_slider = Slider(49, range=0..100)
srf_3 = Surface(srf)
python = GhPythonScript(
    SURFACE_IN=srf_3,
    WEST_DIST=Slider(59, range=0..100),
    SOUTH_DIST=Slider(34, range=0..100),
    NORTH_DIST=Slider(25, range=0..100))  # -> out, SURFACE_OUT
# ---------- python: Python ----------
msg = "ExtendSrf"
ghenv.Component.Message = msg


import rhinoscriptsyntax as rs
import Rhino.Geometry as rg

surface = rs.coercesurface(SURFACE_IN)

if WEST_DIST != None:
    if WEST_DIST > 0:
        print("extend_w")
        surface = surface.Extend(rg.IsoStatus.West, WEST_DIST, True)

if SOUTH_DIST != None:
    if SOUTH_DIST > 0:
        print("extend_s")
        surface = surface.Extend(rg.IsoStatus.South, SOUTH_DIST, True)

if EAST_DIST != None:
    if EAST_DIST > 0:
        print("extend_e")
        surface = surface.Extend(rg.IsoStatus.East, EAST_DIST, True)

if NORTH_DIST != None:
    if NORTH_DIST > 0:
        print("extend_n")
        surface = surface.Extend(rg.IsoStatus.North, NORTH_DIST, True)



SURFACE_OUT = surface
# ---------- end python ----------
srf_4 = Surface(python.SURFACE_OUT)
