# Grasshopper definition OffsetSrf_solid_RC.ghx (Grasshopper 1.0.7)

# ---- group: Negative / Positive
neg = Negative(Value="10")
filter = StreamFilter(Gate=Toggle(False), Stream0="10", Stream1=neg)

# ----
brep = Brep(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)
panel = Panel(filter)
python = GhPythonScript(BREP=brep, DIST=filter)  # -> out, OFFSET_SOLID
# ---------- python: Python ----------
msg = "OffsetSolid"
ghenv.Component.Message = msg

import Rhino
import Rhino.Geometry as rg
import rhinoscriptsyntax as rs


tole = Rhino.RhinoDoc.ActiveDoc.ModelAbsoluteTolerance
# print(tole)

brep_geo = rs.coercebrep(BREP)

brep_off = rg.Brep.CreateOffsetBrep(brep_geo, float(DIST), True, True, True, tole)

OFFSET_SOLID = brep_off[0]
# ---------- end python ----------
brep_2 = Brep(python.OFFSET_SOLID)
panel_2 = Panel(python.out)
